# Requirement set Gardener (R2023b)
Robot_1 will do the work that I don't like doing the most - cleaning.
The requierements are derived from that.

## 1 [1] Robot Capabilities examples (Container)

### 1.1 [#6] Roadworthiness (Container)

#### 1.1.1 [#29] Range
The UGV shall be controllable for all distances within line-of-sight

#### 1.1.2 [#30] Rain Conditions
All UGV components shall be able to operate under rain for at least 10 minutes

#### 1.1.3 [#31] Power
UGV shall provide power to operate all onboard systems for the complete duration of the flight

#### 1.1.4 [#32] Emergency Power
In case of power generation failure, UGV shall provide emergency power for up to 20 minutes of flight for all flight-critical systems.

#### 1.1.5 [#33] Control Surface Fault-Tolerance
UGV shall be tolerant to single-servo failures

#### 1.1.6 [#34] Fuel
UGV propulsion shall be capable of operating with 89 Octane Gasoline

#### 1.1.7 [#35] No Payload Flights
UGV shall be able to safely get airborne without a payload

#### 1.1.8 [#36] Flight Data Recorder
UGV shall provide the means to record all flight data from every component on board for the duration of the flight

#### 1.1.9 [#37] Flight Identification
UGV shall provide an ADSB transponder on board for proper identification

#### 1.1.10 [#38] Lights
UGV shall provide aeronautical standard navigation and strobe lights

#### 1.1.11 [#39] Flight Computer
UGV shall provide a flight computer to autonomously conduct safe flight operations from launch to recovery

#### 1.1.12 [#40] Endurance
The UGV shall be able to sustain uninterrupted flights for up to three hours

#### 1.1.13 [#17] Functional Safety Requirements (Informational)
These will need to be found out.
should fit the 26262 & local Council rules on UGVs on public roads

### 1.2 [#3] Communications (Container)
Can be controlled remotely using a PC/Laptop

#### 1.2.1 [#9] Flight Control
UGV shall provide a dedicated and permanent communications link for command and control for all the range of operations

#### 1.2.2 [#12] Payload
UGV shall provide a dedicated and permanent payload data link for all the range of operations

### 1.3 [#8] Payload Capabilities (Container)
Can carry and house an average parcel

#### 1.3.1 [#16] Carrying Capacity
UGV shall be able to carry up to ___ of payload

#### 1.3.2 [#18] Payload Bay Capacity
UGV shall provide a payload bay with at least ___ cm^3

#### 1.3.3 [#19] Payload Protection
UGV shall be provided with a universal payload-retraction system to protect the payload during takeoff and landing

#### 1.3.4 [#20] Default Payload
UGV shall provide a pre-installed payload in the form of a gimbal-stabilized visual camera providing Full-Motion video.

### 1.4 [#2] Construction (Container)
Has inbuilt HMI

#### 1.4.1 [#14] Dimensions (Container)

##### 1.4.1.1 [#22] Is not longer than a standard delivery driver on a bicycle /

##### 1.4.1.2 [#15] Is not wider than a standard delivery box

#### 1.4.2 [#21] Modularity
UGV shall be constructed in modular components for easy spare part procurement and replacement

## 2 [2] Robot Initial Requirements

### 2.1 [#42] Robot Path Planning

#### 2.1.1 [#45] Robot shall roam the apartment clockwise, following the left wall

#### 2.1.2 [#50] Robot shall gradually move towards the centre of the apartment, covering the whole area of the floor

#### 2.1.3 [#51] Robot shall put itself to charge once the battery is below 20%
Confirm the safe amount of battery charge for Li-ion batteries.

### 2.2 [#44] Robot Additional Characteristics (Container)

#### 2.2.1 [#46] Robot shall produce the least amount of noise possible

#### 2.2.2 [#47] Robot shall have least amount of mass

#### 2.2.3 [#49] Robot shall hold enough charge for 2 full cleans

### 2.3 [#43] Robot Components

#### 2.3.1 [#56] Electrical

##### 2.3.1.1 [#52] Motor

##### 2.3.1.2 [#53] ESC

#### 2.3.2 [#57] Mechanical

##### 2.3.2.1 [#54] Impeller

##### 2.3.2.2 [#58] Electronics Enclosure

##### 2.3.2.3 [#59] Dirt Chamber